# Grasshopper definition Fibonacci_Spiral_C#.gh (Grasshopper 1.0.7)

number_slider = Slider(4, range=0..10)
radians = Radians(Degrees=Slider(10, range=1..10))
line = Line(Line((5.485945329, 2.306087835, 0), (5.485945329, 25.81463553, 0)))
length = Length(Curve=line)
c_script = CSharpScript(inputLine=line, angle=radians, minLength=number_slider)  # -> out, A, B; inputs inputLine: Line, angle: Double, minLength: Double
# ---------- c_script: C# ----------
    List<Line> linesAll = new List<Line>();
    linesAll.Add(inputLine);
    double rotationSum = 0.0;
    //RotateAndScale(inputLine, angle, minLength);
    RotateAndScale(inputLine, ref linesAll, angle, minLength, ref rotationSum);
    A = linesAll;
    B = rotationSum;
# ---------- c_script: C# additional code ----------
  public void RotateAndScale(Line input, ref List<Line> lines, double rotAngle, double minimumLen, ref double totalRotation)
  {
    //check if the lengh of current line (input) is smaller than minimum lengh, if so the method will stop
    if (input.Length < minimumLen) return;
    if (totalRotation >= 2 * Math.PI) return;
    Line newLine = input;
    //scale
    newLine.To = newLine.PointAt(0.95);
    //rotate
    newLine.Transform(Rhino.Geometry.Transform.Rotation(rotAngle, newLine.From));
    lines.Add(newLine);
    totalRotation = totalRotation + rotAngle;

    RotateAndScale(newLine, ref lines, rotAngle, minimumLen, ref totalRotation);
  }
# ---------- end c_script ----------

# ---- group: Iterative version
c_script_2 = CSharpScript(inputLine=line, angle=radians, minLength=number_slider)  # -> out, A; inputs inputLine: Line, angle: Double, minLength: Double
# ---------- c_script_2: C# ----------
    List<Line> lines = new List<Line>();
    lines.Add(inputLine);
    Line lastLine = inputLine;

    while(lastLine.Length >= minLength)
    {
      Line newLine = RotateAndScale(lastLine, angle);
      lines.Add(newLine);
      lastLine = newLine;
    }
    A = lines;
# ---------- c_script_2: C# additional code ----------
  public Line RotateAndScale(Line currentLine, double rotatingAngle)
  {
    Line newLine = currentLine;
    //scale
    newLine.To = newLine.PointAt(0.95);
    //rotate
    newLine.Transform(Rhino.Geometry.Transform.Rotation(rotatingAngle, newLine.From));
    return newLine;

  }
# ---------- end c_script_2 ----------

# ----
list_item = ListItem(List=c_script.A, Index="-1", Wrap=True)
degrees = Degrees(Radians=c_script.B)
