# Grasshopper definition Kangaroo_Pavillion_Fabrication.gh (Grasshopper 1.0.7)
# plug-ins: Heteroptera, LunchBox, MeshEdit Components, Kangaroo2 Components, Pufferfish, Weaverbird

number_slider = Slider(5, range=0..10)
multiplication = Multiplication(A=number_slider, B=-1)
curve = Curve([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])
line = Line(curve)
offset_curve = OffsetCurve(Curve=graft(line), Distance=[number_slider, multiplication], Corners=1)
network_from_lines = NetworkFromLines(Lines=line)  # -> PointPointTopology, ConnectionPointTopology, Points, Lines
trim_tree = TrimTree(Tree=offset_curve, Depth=1)
loft = Loft(Curves=trim_tree, Options={Adjust=False, Closed=False, LoftEnds=0, LoftSimp=0, LoftType=0, Rebuild=10, Refit=0.01})
end_points = EndPoints(Curve=network_from_lines.Lines)  # -> Start, End
region_union = RegionUnion(Curves=flatten(loft))
boundary_surfaces = BoundarySurfaces(Edges=region_union)
end_points_2 = EndPoints(Curve=line)  # -> Start, End
point = Point([end_points_2.End, end_points_2.Start])
point_2 = Point([end_points.Start, end_points.End])
set_difference = SetDifference(SetA=point_2, SetB=point)
point_3 = Point(set_difference)
sort_duplicate_points = SortDuplicatePoints(Points=point_2)  # -> UniquePoints, Indices
prune_tree = PruneTree(Tree=sort_duplicate_points.Indices, Minimum=Slider(2, range=0..10), Maximum=Slider(100, range=0..100))
panel = Panel(prune_tree)
sort_duplicate_points_2 = SortDuplicatePoints(Points=point_3)  # -> UniquePoints, Indices
list_item = ListItem(List=prune_tree, Index=0, Wrap=True)
panel_2 = Panel(sort_duplicate_points.Indices)
deconstruct_brep = DeconstructBrep(Brep=boundary_surfaces)  # -> Faces, Edges, Vertices
list_item_2 = ListItem(List=point_2, Index=list_item, Wrap=True)
point_4 = Point(sort_duplicate_points_2.UniquePoints)
closest_points = ClosestPoints(Point=graft(point_4), Cloud=deconstruct_brep.Vertices, Count=Slider(4, range=0..10))  # -> ClosestPoint, CPIndex, Distance
line_2 = Line(StartPoint=graft(point_4), EndPoint=closest_points.ClosestPoint)
line_3 = Line(flatten([line_2, line]))
surface_split = SurfaceSplit(Surface=boundary_surfaces, Curves=line_3)
duplicate_data = DuplicateData(Data=flatten(loft), Number=2, Order=Toggle(False))
deconstruct_brep_2 = DeconstructBrep(Brep=loft)  # -> Faces, Edges, Vertices
length = Length(Curve=line)
simple_mesh = SimpleMesh(Brep=surface_split)
panel_3 = Panel(duplicate_data)
highest_lowest_numbers = HighestLowestNumbers(Numbers=length)  # -> Highest, Lowest
length_2 = Length(Curve=deconstruct_brep_2.Edges)
mesh_join = MeshJoin(Meshes=simple_mesh)
smaller_than = SmallerThan(FirstNumber=flatten(length_2), SecondNumber=highest_lowest_numbers.Lowest)  # -> SmallerThan, OrEqualTo
line_4 = Line(flatten(deconstruct_brep_2.Edges))
mesh_weldvertices = MeshWeldVertices(Mesh=mesh_join, Tolerance=0.01)  # -> RuntimeMessage, Mesh
dispatch = Dispatch(List=smaller_than.SmallerThan, DispatchPattern=[True, False])  # -> ListA, ListB
item_index = ItemIndex(List=smaller_than.SmallerThan, Item=dispatch.ListA)
refine = Refine(Mesh=mesh_weldvertices.Mesh, Level=Slider(3, range=1..3))
list_item_3 = ListItem(List=line_4, Index=item_index, Wrap=True)
length_3 = Length(Curve=list_item_3)
mesh_edges = MeshEdges(Mesh=refine)  # -> NakedEdges, InteriorEdges, NonManifoldEdges
curve_middle = CurveMiddle(Curve=list_item_3)
division = Division(A=length_3, B=2)
circle = Circle(Plane=curve_middle, Radius=division)
curve_2 = Curve(circle)
nakedvertices = NakedVertices(Mesh=refine)  # -> ClothedIndex, NakedIndex, ClothedPts, NakedPts
trim_with_region = TrimWithRegion(Curve=curve_2, Region=region_union)  # -> Inside, Outside
curve_closest_point = CurveClosestPoint(Point=nakedvertices.NakedPts, Curve=graft(list_item_3))  # -> Point, Parameter, Distance
panel_4 = Panel(curve_closest_point.Distance)
smaller_than_2 = SmallerThan(FirstNumber=curve_closest_point.Distance, SecondNumber=Slider(0.1, range=0..0.1))  # -> SmallerThan, OrEqualTo
panel_5 = Panel(smaller_than_2.SmallerThan)
dispatch_2 = Dispatch(List=curve_closest_point.Distance, DispatchPattern=smaller_than_2.SmallerThan)  # -> ListA, ListB
dispatch_3 = Dispatch(List=nakedvertices.NakedPts, DispatchPattern=smaller_than_2.SmallerThan)  # -> ListA, ListB
curve_3 = Curve(trim_with_region.Outside)
panel_6 = Panel(dispatch_2.ListA)
number_slider_2 = Slider(100, range=0..100)
list_length = ListLength(List=dispatch_3.ListA)  # -> flatten(Length)
unit_z = UnitZ(Factor=Slider(0.517, range=0.001..10))
list_item_4 = ListItem(List=list_length, Index=0, Wrap=True)
length_4 = Length(Curve=mesh_edges.NakedEdges)
number_slider_3 = Slider(0.1, range=0.1..10)
multiplication_2 = Multiplication(A=length_4, B=Slider(0.9, range=0..1))
divide_curve = DivideCurve(Curve=curve_3, Count=expr("x-1", list_item_4), Kinks=False)  # -> Points, Tangents, Parameters
sort_along_curve = SortAlongCurve(Points=dispatch_3.ListA, Curve=graft(list_item_3))  # -> Points, Indices
load = Load(Point=nakedvertices.ClothedPts, ForceVector=unit_z, Weighting=1)
oncurve = OnCurve(Points=dispatch_3.ListA, Curve=curve_3, Strength=Slider(1000, range=0..1000))
edgelengths = EdgeLengths(Mesh=refine, LengthFactor=Slider(0.3, range=0..1), Strength=1)
number_slider_4 = Slider(0.4, range=0..1)
pressure = Pressure(M=refine, Strength=Slider(0.01, range=0.01..0.1))
show = Show(G=refine)
length_line = LengthLine(Line=mesh_edges.NakedEdges, Length=multiplication_2, Strength=10)
sort_along_curve_2 = SortAlongCurve(Points=divide_curve.Points, Curve=curve_3)  # -> Points, Indices
point_list = PointList(Points=sort_along_curve.Points, Size=number_slider_4)
line_5 = Line(StartPoint=sort_along_curve.Points, EndPoint=sort_along_curve_2.Points)
reverse_list = ReverseList(List=sort_along_curve_2.Points)
anchor = Anchor(Point=sort_along_curve.Points, Target=reverse_list, Strength=10000)
entwine = Entwine(
    Branch00=show,
    Branch01=edgelengths,
    Branch02=load,
    Branch03=anchor,
    Branch04=pressure,
    Branch05=length_line,
    FlattenInputs=True)
bouncysolver = BouncySolver(GoalObjects=entwine, Reset=Button(), Threshold=1e-15, Tolerance=0.0001, Damping=0.99, Iterations=10, On=Toggle(False))  # -> I, V, O
point_list_2 = PointList(Points=reverse_list, Size=number_slider_4)
panel_7 = Panel(reverse_list)
clean_tree = CleanTree(RemoveNulls=True, RemoveInvalid=True, RemoveEmpty=False, Tree=bouncysolver.O)
list_item_5 = ListItem(List=clean_tree, Index=0, Wrap=True)
mesh = Mesh(list_item_5)
meshdirection = MeshDirection(Mesh=mesh)
weaverbird_s_constant_quads_split_subdiv = WeaverbirdsConstantQuadsSplitSubdivision(MeshCurves=list_item_5, Level=1, SmoothNakedEdges=Slider(0, range=0..100))
stripper = Stripper(Mesh=meshdirection)
mesh_edges_2 = MeshEdges(Mesh=stripper)  # -> NakedEdges, InteriorEdges, NonManifoldEdges
list_length_2 = ListLength(List=stripper)
list_item_6 = ListItem(List=stripper, Index=Slider(33, range=0..63), Wrap=True)
colour_wheel = ColourWheel(
    list_length_2,
    ColourGrips_Style=40,
    ColourGrips_Grip=[4.290701461, 1.149108808, 5.861497788, 3.124898537],
    ColourGrips_Lum=[0.1, 0.4959024026],
    ColourGrips_Range=[0.2617993878, 0.2617993878, 0.2617993878, 0.2617993878],
    ColourGrips_Sat=[0.2, 0.6])
mesh_colours = MeshColours(Mesh=graft(stripper), Colours=graft(colour_wheel))
