# Grasshopper definition Lamp_Fabrication.gh (Grasshopper 1.0.7)
# plug-ins: Weaverbird, Kangaroo2 Components

number_slider = Slider(4, range=0..100)
# Independent Variables
roatation = Slider(2.7, range=0..10)
offset_distance = Slider(8, range=0..100)

rad = Radians(Degrees="45")
polygon = Polygon(Plane=PlaneXY(0, 0, 0), Radius=Slider(7.5, range=5..15), Segments=Slider(3, range=0..10), FilletRadius=0)  # -> Polygon, Length
series = Series(Start=0, Step=offset_distance, Count=number_slider)
rad_2 = Radians(Degrees=Slider(30, range=0..1000))
rotate = Rotate(Geometry=polygon.Polygon, Angle=rad, Plane=PlaneXY(0, 0, 0))  # -> Geometry, Transform
area = Area(Geometry=rotate.Geometry)  # -> Area, Centroid
eval = Evaluate(F="x-1", x=number_slider)
Z = UnitZ(Factor=series)
move = Move(Geometry=rotate.Geometry, Motion=Z)  # -> Geometry, Transform
range = Range(Domain=rad_2, Steps=eval)
xy = XYPlane(Origin=area.Centroid)
rotate_2 = Rotate(Geometry=move.Geometry, Angle=range, Plane=xy)  # -> Geometry, Transform
xy_2 = XYPlane(Origin=Z)
dom = ConstructDomain(DomainStart=Slider(0.0001, range=0.0001..1), DomainEnd=Slider(1, range=0..1))
range_2 = Range(Domain=dom, Steps=eval)
graph = GraphMapper(
    reverse(range_2),
    x0=0,
    x1=1,
    y0=0,
    y1=1,
    Ox=0.506121099,
    Oy=0.5546122789,
    Px=0.9138011336,
    Py=0.8749289513,
    container_name="Parabola")
graph_2 = GraphMapper(
    range_2,
    x0=0,
    x1=1,
    y0=0,
    y1=1,
    A=-0.2208945191,
    B=0.6180858413,
    container_name="Linear",
    Graph_x0=0.1012911946,
    Graph_x1=0.9359752536,
    Graph_y0=0.5957111716,
    Graph_y1=0.4113340378)
scale = Scale(Geometry=rotate_2.Geometry, Center=xy_2, Factor=graph_2)  # -> Geometry, Transform
item = ListItem(List=scale.Geometry, Index="1", Wrap=True)
item_2 = ListItem(List=scale.Geometry, Index="2", Wrap=True)
loft_opt = LoftOptions(Closed=False, Adjust=False, Rebuild=0, Refit=0, Type=Slider(3, range=0..10))
item_3 = ListItem(List=scale.Geometry, Index="4", Wrap=True)
item_4 = ListItem(List=scale.Geometry, Index="0", Wrap=True)
item_5 = ListItem(List=scale.Geometry, Index="3", Wrap=True)
number_slider_2 = Slider(2, range=0..10)
X = UnitX(Factor=Slider(2, range=0..5))
X_2 = UnitX(Factor=Slider(0, range=0..5))
move_2 = Move(Geometry=item, Motion=X)  # -> Geometry, Transform
X_3 = UnitX(Factor=Slider(4, range=0..5))
move_3 = Move(Geometry=item_2, Motion=X_2)  # -> Geometry, Transform
X_4 = UnitX(Factor=Slider(3, range=0..5))
move_4 = Move(Geometry=item_3, Motion=X_3)  # -> Geometry, Transform
move_5 = Move(Geometry=item_5, Motion=X_4)  # -> Geometry, Transform
loft = Loft(Curves=[move_5.Geometry, move_3.Geometry, move_2.Geometry, item_4], Options=loft_opt)
mesh = MeshBrep(
    Brep=loft,
    Settings={GridMaxCount=0, GridMinCount=0, JaggedSeams=False, MaxEdgeLength=0, MinEdgeLength=10, MinTolerance=0, Refine=False, RefineAngle=0, RelativeTolerance=0, SimplePlanes=False, Tolerance=0})
smesh = SimpleMesh(Brep=loft)
tri = Triangulate(Mesh=mesh)  # -> Mesh, Count
wbframe = WeaverbirdsPictureFrame(MeshPolylines=tri.Mesh, Distance=number_slider_2, InsetType=0)
wbwindow = WeaverbirdsMeshWindow(MeshPolylines=tri.Mesh, Distance=number_slider_2, InsetType=0)
demesh = DeconstructMesh(Mesh=tri.Mesh)  # -> Vertices, Faces, Colours, Normals
duppt = RemoveDuplicatePts(Points=demesh.Vertices, Tolerance=0.01)
sph = Sphere(Base=duppt, Radius=Slider(0.6, range=0..1))
wbthicken = WeaverbirdsMeshThicken(MeshCurves=wbwindow, Distance=Slider(0.3, range=0..1), OffsetType=0)
lng = ListLength(List=sph)
points = PointList(Points=duppt, Size="2")
area_2 = Area(Geometry=sph)  # -> Area, Centroid
series_2 = Series(Start=0, Step=1, Count=lng)
faceb = FaceBoundaries(Mesh=wbwindow)
format = Evaluate(F=flatten("Format(\"C{0}\",x)"), x=series_2)
lng_2 = ListLength(List=faceb)
series_3 = Series(Start=1, Step=1, Count=lng_2)
faceb_2 = FaceBoundaries(Mesh=wbthicken)
text_size = Slider(9, range=0..12)
boundary = BoundarySurfaces(Edges=faceb_2)
format_2 = Evaluate(F=flatten("Format(\"A{0}\",x)"), x=series_3)
demesh_2 = DeconstructMesh(Mesh=wbwindow)  # -> Vertices, Faces, Colours, Normals
eval_2 = Evaluate(F="x/12", x=text_size)
tag_spheres = TextTag3D(Location=flatten(area_2.Centroid), Text=format, Size=eval_2, Justification=7)
area_3 = Area(Geometry=faceb)  # -> Area, Centroid
join = BrepJoin(Breps=boundary)  # -> Breps, Closed
deface = DeconstructFace(Face=demesh_2.Faces)  # -> CornerA, CornerB, CornerC, CornerD
item_6 = ListItem(List=scale.Geometry, Index=0, Wrap=True)
item_7 = ListItem(List=demesh_2.Vertices, Index=deface.CornerA, Wrap=True)
taga = TextTag3D(Location=flatten(area_3.Centroid), Text=format_2, Size=eval_2, Justification=2)
item_8 = ListItem(List=demesh_2.Vertices, Index=deface.CornerB, Wrap=True)
pl_3pt = Plane3Pt(PointA=area_3.Centroid, PointB=item_8, PointC=item_7)
offset = OffsetCurve(Curve=item_6, Distance="-1.5", Plane=PlaneXY(0, 0, 0), Corners=1)
offset_2 = OffsetCurve(Curve=item_6, Distance="1.5", Plane=PlaneXY(0, 0, 0), Corners=1)
dom_2 = ConstructDomain(DomainStart=Slider(10, range=0..10), DomainEnd=Slider(42, range=0..100))
loft_opt_2 = LoftOptions(Closed=False, Adjust=False, Rebuild=0, Refit=0, Type="3")
planesrf = PlaneSurface(Plane=PlaneXY(0, 0, 0), XSize=dom_2, YSize=dom_2)
loft_2 = Loft(Curves=[offset, offset_2], Options=loft_opt_2)
Z_2 = UnitZ(Factor=Slider(-0.5, range=-5..0))
sframes = SurfaceFrames(Surface=planesrf, UCount=Slider(3, range=0..10), VCount=Slider(5, range=0..10))  # -> Frames, Parameters
extr = Extrude(Base=loft_2, Direction=Z_2)
rad_3 = Radians(Degrees=Slider(6, range=0..360))
rotate_3 = Rotate(Geometry=sframes.Frames, Angle=rad_3, Plane=sframes.Frames)  # -> Geometry, Transform
orient = Orient(Geometry=flatten(join.Breps), Source=flatten(pl_3pt), Target=flatten(rotate_3.Geometry))  # -> Geometry, Transform
tagflatten_a = TextTag3D(Location=flatten(sframes.Frames), Text=format_2, Size=eval_2, Justification=7)
