# Grasshopper definition Residential_Planning_py.gh (Grasshopper 1.0.7)

pt = Point(Point(1290.966544, 212.5935303, 0))
pt_2 = Point(Point(1290.966544, 212.5935303, 0))
crv = Curve([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])
crv_2 = Curve([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])
crv_3 = Curve(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)
crv_4 = Curve(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)
pt_3 = Point(Point(1290.966544, 212.5935303, 0))
pt_4 = Point(Point(1290.966544, 212.5935303, 0))
crv_5 = Curve([<curve referenced from the Rhino model> x11])
crv_6 = Curve([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])
crv_7 = Curve(<curve referenced from the Rhino model>)
crv_8 = Curve(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)
python = GhPythonScript(
    Planning_Area=crv_3,
    polygs=crv,
    pt=pt,
    height=Slider(30, range=0..100),
    min_unit_width=Slider(15, range=15..100),
    offset=Slider(5, range=0..10),
    unit_depth=Slider(15, range=0..100),
    floor_height=Slider(3, range=2.5..5))  # -> out, a, buildings; inputs polygs: list
# ---------- python: Python ----------
__author__ = "karee"
__version__ = "2020.06.12"

import rhinoscriptsyntax as rs
import Rhino


sone = rs.AddPoint((0,0,0))
stwo = rs.AddPoint((0,-100,0))
south = rs.VectorCreate(stwo, sone)
exsone = (0, 0, 0)
exstwo = (0, 0, height * 2/3)

exlone = (0, 0, 0)
exltwo = (0, 0, height)

Units = []
Areas_polygons = []
Areas_intersections = []
volumes = []
buildings = []
foot_print_areas = []
#Planning_Area = rs.GetObject(message="choose planning area", filter = 4)

def checkintersection(small_rec, large_rec):
    result = False
    for u in Units:
        intersects_s = rs.CurveCurveIntersection(u, small_rec)
        intersects_l = rs.CurveCurveIntersection(u, large_rec)
        if not(intersects_s == None) or not(intersects_l == None):
            result = True
    return result

def checkinArea(a,b,c,d):
    result = False
    if rs.PointInPlanarClosedCurve(a, Planning_Area) == True:
        if rs.PointInPlanarClosedCurve(b, Planning_Area) == True:
            if rs.PointInPlanarClosedCurve(c, Planning_Area) == True:
                if rs.PointInPlanarClosedCurve(d, Planning_Area) == True:
                    result = True
    return result

def lines():
    Number_of_units = 0
    #polygs = rs.GetObjects(message="Choose closed curves", filter = 4)
    #print type(polygs)
    #print list(polygs)
    for i in polygs:
        Areas_polygons.append(rs.Area(i))
    
    for e in range(len(polygs)):
        for f in range(e+1, len(polygs)):
            if rs.CurveCurveIntersection(polygs[e], polygs[f]) != None:
                int = rs.CurveBooleanIntersection(polygs[e], polygs[f])
                Areas_intersections.append(rs.Area(int))
    
    #pt = rs.GetObject(message="Choose Offset point outside of the curves")
    
    for p in polygs:
        lists = []
        newlists = []
        if rs.CurveDegree(p) == 1:
            list = []
            newlist = []
            off_one = rs.OffsetCurve(p, pt, offset)
            off_two = rs.OffsetCurve(p, pt, unit_depth + offset)
            exp_one = rs.ExplodeCurves(off_one)
            exp_two = rs.ExplodeCurves(off_two)
            for e in range(0, len(exp_one)):
                if rs.CurveLength(exp_one[e]) >= min_unit_width:
                    pts_n = []
                    pts_m = rs.DivideCurve(exp_one[e], rs.CurveLength(exp_one[e]) // min_unit_width, return_points=True)
                    for p in pts_m:
                        par = rs.CurveClosestPoint(exp_two[e], p)
                        p_n = rs.EvaluateCurve(exp_two[e], par)
                        pts_n.append(p_n)
                    
                    if len(pts_m) == 2:
                        m_lines = [rs.AddPolyline(pts_m)]
                        n_lines = [rs.AddPolyline(pts_n)]
                    else:
                        m_lines = rs.ExplodeCurves(rs.AddPolyline(pts_m))
                        n_lines = rs.ExplodeCurves(rs.AddPolyline(pts_n))
                
                    for m in m_lines:
                        list.append(m)
                    for n in n_lines:
                        newlist.append(n)
                    #list.append(m)
                    #newlist.append(n)
                    lists.append(list)
                    newlists.append(newlist)
                else:
                    break
                

        else:
            div = rs.DivideCurve(p, rs.CurveLength(p) // min_unit_width)
            div.append(div[0])
            div_crv = rs.AddPolyline(div)
            f = rs.ConvertCurveToPolyline(div_crv, angle_tolerance=5.0 , min_edge_length=40)
            m = rs.OffsetCurve(f, pt, 5)
            n = rs.OffsetCurve(f, pt, 20)
            list = rs.ExplodeCurves(m)
            newlist = rs.ExplodeCurves(n)
            lists.append(list)
            newlists.append(newlist)


        for j in range(0, len(lists)):
            for i in range(0, len(list)):
                sides = []
                normal_angles = []
                a = rs.CurveStartPoint(list[i])
                b = rs.CurveEndPoint(list[i])
                para = rs.CurveClosestPoint(newlist[i], b)
                c = rs.EvaluateCurve(newlist[i], para)
                parb = rs.CurveClosestPoint(newlist[i], a)
                d = rs.EvaluateCurve(newlist[i], parb)
                
                ab = rs.AddLine(a, b)
                bc = rs.AddLine(b, c)
                cd = rs.AddLine(c, d)
                da = rs.AddLine(d, a)
                
                sides.append(ab)
                sides.append(bc)
                sides.append(cd)
                sides.append(da)
                       
                ab_normal = rs.VectorCreate(b, c)
                bc_normal = rs.VectorCreate(c, d)
                cd_normal = rs.VectorCreate(d, a)
                da_normal = rs.VectorCreate(a, b)
                
                ang_ab_normal = rs.VectorAngle(south, ab_normal)
                ang_bc_normal = rs.VectorAngle(south, bc_normal)
                ang_cd_normal = rs.VectorAngle(south, cd_normal)
                ang_da_normal = rs.VectorAngle(south, da_normal)
                
                normal_angles.append(ang_ab_normal)
                normal_angles.append(ang_bc_normal)
                normal_angles.append(ang_cd_normal)
                normal_angles.append(ang_da_normal)
                
                index_min_angle = normal_angles.index(min(normal_angles))
                chosen_facade = sides[index_min_angle]
                factor = 20*min(normal_angles) / 45
                #foot_print_areas.append(rs.Area(rs.AddPolyline([a, b, c, d, a])))
                
                if chosen_facade == ab:
                    rs.EnableRedraw(False)
                    pts_small = []
                    pts_large = []
                    div = rs.DivideCurve(bc, 3)
                    npt = div[1]
                    tr = rs.VectorCreate(npt, b)
                    shift_ab = rs.CopyObject(ab, tr)
                    shift_a = rs.CurveStartPoint(shift_ab)
                    shift_b = rs.CurveEndPoint(shift_ab)
                    
                    pts_small.append(a)
                    pts_small.append(b)
                    pts_small.append(shift_b)
                    pts_small.append(shift_a)
                    pts_small.append(a)
                    small_rec = rs.ScaleObject(rs.AddPolyline(pts_small), shift_a, (0.9, 0.9, 0.9))
                    #volumes.append(rs.Area(small_rec ) * (exstwo[2] + factor))
 
                    pts_large.append(shift_a)
                    pts_large.append(shift_b)
                    pts_large.append(c)
                    pts_large.append(d)
                    pts_large.append(shift_a)
                    large_rec = rs.ScaleObject(rs.AddPolyline(pts_large), shift_a, (0.9, 0.9, 0.9))
                    #volumes.append(rs.Area(large_rec ) * (exltwo[2] + factor))
                    
                    Ex_S = rs.ExtrudeCurveStraight(small_rec, exsone, [exstwo[0], exstwo[1], exstwo[2]+factor])
                    Ex_L = rs.ExtrudeCurveStraight(large_rec, exlone, [exltwo[0], exltwo[1], exltwo[2]+factor])
                    
                    buildings.append(Ex_S)
                    buildings.append(Ex_L)
                    
                    if checkintersection(small_rec, large_rec) == False and checkinArea(a,b,c,d) == True:
                        Units.append(small_rec)
                        Units.append(large_rec)
                        Number_of_units += 1
                        foot_print_areas.append(rs.Area(small_rec))
                        foot_print_areas.append(rs.Area(large_rec))
                        volumes.append(rs.Area(small_rec ) * (exstwo[2] + factor))
                        volumes.append(rs.Area(large_rec ) * (exltwo[2] + factor))
                    else:
                        buildings.remove(Ex_S)
                        buildings.remove(Ex_L)
                        #rs.DeleteObjects([Ex_S, Ex_L, small_rec, large_rec, ab, bc, cd, da])
                    rs.EnableRedraw(True)
                    
                    

                elif chosen_facade == cd:
                    rs.EnableRedraw(False)
                    pts_small = []
                    pts_large = []
                    div = rs.DivideCurve(bc, 3)
                    npt = div[2]
                    tr = rs.VectorCreate(npt, c)
                    shift_cd = rs.CopyObject(cd, tr)
                    shift_c = rs.CurveStartPoint(shift_cd)
                    shift_d = rs.CurveEndPoint(shift_cd)
                    
                    pts_small.append(c)
                    pts_small.append(d)
                    pts_small.append(shift_d)
                    pts_small.append(shift_c)
                    pts_small.append(c)
                    small_rec = rs.ScaleObject(rs.AddPolyline(pts_small), shift_c, (0.9, 0.9, 0.9))
                    #volumes.append(rs.Area(small_rec ) * (exstwo[2] + factor))
                    
                    pts_large.append(shift_c)
                    pts_large.append(shift_d)
                    pts_large.append(a)
                    pts_large.append(b)
                    pts_large.append(shift_c)
                    large_rec = rs.ScaleObject(rs.AddPolyline(pts_large), shift_c, (0.9, 0.9, 0.9))
                    Ex_S = rs.ExtrudeCurveStraight(small_rec, exsone, [exstwo[0], exstwo[1], exstwo[2]+factor])
                    Ex_L =rs.ExtrudeCurveStraight(large_rec, exlone, [exltwo[0], exltwo[1], exltwo[2]+factor])
                    
                    buildings.append(Ex_S)
                    buildings.append(Ex_L)
                    
                    #volumes.append(rs.Area(large_rec ) * (exltwo[2] + factor))
                    
                    if checkintersection(small_rec, large_rec) == False and checkinArea(a,b,c,d) == True:
                        Units.append(small_rec)
                        Units.append(large_rec)
                        Number_of_units += 1
                        foot_print_areas.append(rs.Area(small_rec))
                        foot_print_areas.append(rs.Area(large_rec))
                        volumes.append(rs.Area(small_rec ) * (exstwo[2] + factor))
                        volumes.append(rs.Area(large_rec ) * (exltwo[2] + factor))
                    else:
                        buildings.remove(Ex_S)
                        buildings.remove(Ex_L)
                        #rs.DeleteObjects([Ex_S, Ex_L, small_rec, large_rec, ab, bc, cd, da])
                    rs.EnableRedraw(True)

                    
                elif chosen_facade == bc:
                    rs.EnableRedraw(False)
                    pts_small = []
                    pts_large = []
                    div = rs.DivideCurve(ab, 3)
                    npt = div[2]
                    tr = rs.VectorCreate(npt, b)
                    shift_bc = rs.CopyObject(bc, tr)
                    shift_b = rs.CurveStartPoint(shift_bc)
                    shift_c = rs.CurveEndPoint(shift_bc)
                    
                    pts_small.append(b)
                    pts_small.append(c)
                    pts_small.append(shift_c)
                    pts_small.append(shift_b)
                    pts_small.append(b)
                    small_rec =  rs.ScaleObject(rs.AddPolyline(pts_small), shift_b, (0.9, 0.9, 0.9))
                    #volumes.append(rs.Area(small_rec ) * (exstwo[2] + factor))
                    
                    pts_large.append(shift_b)
                    pts_large.append(shift_c)
                    pts_large.append(d)
                    pts_large.append(a)
                    pts_large.append(shift_b)
                    large_rec = rs.ScaleObject(rs.AddPolyline(pts_large), shift_b, (0.9, 0.9, 0.9))
                    #volumes.append(rs.Area(large_rec ) * (exltwo[2] + factor))
                    
                    Ex_S = rs.ExtrudeCurveStraight(small_rec, exsone, [exstwo[0], exstwo[1], exstwo[2]+factor])
                    Ex_L = rs.ExtrudeCurveStraight(large_rec, exlone, [exltwo[0], exltwo[1], exltwo[2]+factor])
                    
                    buildings.append(Ex_S)
                    buildings.append(Ex_L)
                    
                    if checkintersection(small_rec, large_rec) == False and checkinArea(a,b,c,d) == True:
                        Units.append(small_rec)
                        Units.append(large_rec)
                        Number_of_units += 1
                        foot_print_areas.append(rs.Area(small_rec))
                        foot_print_areas.append(rs.Area(large_rec))
                        volumes.append(rs.Area(small_rec ) * (exstwo[2] + factor))
                        volumes.append(rs.Area(large_rec ) * (exltwo[2] + factor))
                    else:
                        buildings.remove(Ex_S)
                        buildings.remove(Ex_L)
                        #rs.DeleteObjects([Ex_S, Ex_L, small_rec, large_rec, ab, bc, cd, da])
                    rs.EnableRedraw(True)
                    


                elif chosen_facade == da:
                    rs.EnableRedraw(False)
                    pts_small = []
                    pts_large = []
                    div = rs.DivideCurve(cd, 3)
                    npt = div[2]
                    tr = rs.VectorCreate(npt, d)
                    shift_da = rs.CopyObject(da, tr)
                    shift_d = rs.CurveStartPoint(shift_da)
                    shift_a = rs.CurveEndPoint(shift_da)
                    
                    pts_small.append(d)
                    pts_small.append(a)
                    pts_small.append(shift_a)
                    pts_small.append(shift_d)
                    pts_small.append(d)
                    small_rec = rs.ScaleObject(rs.AddPolyline(pts_small), shift_d, (0.9, 0.9, 0.9))
                    #volumes.append(rs.Area(small_rec ) * (exstwo[2] + factor))
                    
                    pts_large.append(shift_a)
                    pts_large.append(shift_d)
                    pts_large.append(c)
                    pts_large.append(b)
                    pts_large.append(shift_a)
                    large_rec = rs.ScaleObject(rs.AddPolyline(pts_large), shift_d, (0.9, 0.9, 0.9))
                    #volumes.append(rs.Area(large_rec ) * (exltwo[2] + factor))
                    
                    Ex_S = rs.ExtrudeCurveStraight(small_rec, exsone, [exstwo[0], exstwo[1], exstwo[2]+factor])
                    Ex_L = rs.ExtrudeCurveStraight(large_rec, exlone, [exltwo[0], exltwo[1], exltwo[2]+factor])
                    
                    buildings.append(Ex_S)
                    buildings.append(Ex_L)
                    
                    if checkintersection(small_rec, large_rec) == False and checkinArea(a,b,c,d) == True:
                        Units.append(small_rec)
                        Units.append(large_rec)
                        Number_of_units += 1
                        foot_print_areas.append(rs.Area(small_rec))
                        foot_print_areas.append(rs.Area(large_rec))
                        volumes.append(rs.Area(small_rec ) * (exstwo[2] + factor))
                        volumes.append(rs.Area(large_rec ) * (exltwo[2] + factor))
                    else:
                        buildings.remove(Ex_S)
                        buildings.remove(Ex_L)
                        #rs.DeleteObjects([Ex_S, Ex_L, small_rec, large_rec, ab, bc, cd, da])
                    rs.EnableRedraw(True)
     
    return buildings

#lines()

buildings = lines()



Landscape =  sum(Areas_polygons) - sum(Areas_intersections)
Volumes = sum(volumes)

print("Foot Print Areas = " + str("{:,}".format(int(sum(foot_print_areas)))) + " m2")
print("Landscape Area is " + str("{:,}".format(int(Landscape))) + " m2")
print("Built Up Area is " + str("{:,}".format(int(Volumes / floor_height))) + " m2")
print("Number of units is " + str(int(len(Units)/2)))
# ---------- end python ----------
python_2 = GhPythonScript(
    Planning_Area=crv_4,
    polygs=crv_2,
    pt=pt_2,
    height=Slider(30, range=0..100),
    min_unit_width=Slider(15, range=15..100),
    offset=Slider(5, range=0..10),
    unit_depth=Slider(15, range=0..100),
    floor_height=Slider(3, range=2.5..5))  # -> out, a, buildings; inputs polygs: list; same code as python
python_3 = GhPythonScript(
    Planning_Area=crv_7,
    polygs=crv_5,
    pt=pt_3,
    height=Slider(30, range=0..100),
    min_unit_width=Slider(15, range=15..100),
    offset=Slider(5, range=0..10),
    unit_depth=Slider(15, range=0..100),
    floor_height=Slider(3, range=2.5..5))  # -> out, a, buildings; inputs polygs: list; same code as python
python_4 = GhPythonScript(
    Planning_Area=crv_8,
    polygs=crv_6,
    pt=pt_4,
    height=Slider(30, range=0..100),
    min_unit_width=Slider(15, range=15..100),
    offset=Slider(5, range=0..10),
    unit_depth=Slider(15, range=0..100),
    floor_height=Slider(3, range=2.5..5))  # -> out, a, buildings; inputs polygs: list; same code as python
panel = Panel(python.out)
panel_2 = Panel(python_2.out)
panel_3 = Panel(python_3.out)
panel_4 = Panel(python_4.out)
pt_5 = Point(Point(1290.966544, 212.5935303, 0))
crv_9 = Curve([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])
crv_10 = Curve(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)
python_5 = GhPythonScript(
    Planning_Area=crv_10,
    polygs=crv_9,
    pt=pt_5,
    height=Slider(30, range=0..100),
    min_unit_width=Slider(15, range=15..100),
    offset=Slider(5, range=0..10),
    unit_depth=Slider(15, range=0..100),
    floor_height=Slider(3, range=2.5..5))  # -> out, a, buildings; inputs polygs: list; same code as python
panel_5 = Panel(python_5.out)
