# Grasshopper definition Sierpinski pyramid in noise landscape.gh (Grasshopper 1.0.7)
# plug-ins: Noise 4D

# ---- group: Original Landscape
frequency = Slider(0.04, range=0..1)
amplitude = Slider(4, range=0..10)
alpha = Slider(0.174, range=0..1)
number_slider = Slider(1, range=0..10)

to_move_around_the_map = Slider(0, range=0..100)
number_slider_2 = Slider(400, range=0..400)
number_slider_3 = Slider(0.5, range=0..1)
series = Series(Start=to_move_around_the_map, Step=number_slider_3, Count=number_slider_2)
series_2 = Series(Start=to_move_around_the_map, Step=number_slider_3, Count=number_slider_2)
pt = ConstructPoint(XCoordinate=series_2, YCoordinate=graft(series), ZCoordinate=0)  # -> flatten(Point)
expression = Expression(f=frequency, Expression="f*0.5")
expression_2 = Expression(A=amplitude, Expression="A/1")
expression_3 = Expression(A=amplitude, Expression="A/7")
expression_4 = Expression(f=frequency, Expression="f*7")
expression_5 = Expression(A=amplitude, Expression="A/1")
expression_6 = Expression(f=frequency, Expression="f*1")
pdecon = Deconstruct(Point=pt)  # -> XComponent, YComponent, ZComponent
perlin = PerlinNoise(Values=pt, Time=number_slider, Scale=expression)
perlin_2 = PerlinNoise(Values=pt, Time=number_slider, Scale=expression_4)
perlin_3 = PerlinNoise(Values=pt, Time=number_slider, Scale=expression_6)
multiplication = Multiplication(A=perlin, B=expression_2)
multiplication_2 = Multiplication(A=perlin_2, B=expression_3)
multiplication_3 = Multiplication(A=perlin_3, B=expression_5)
expression_7 = Expression(
    alpha=alpha,
    A=multiplication,
    B=multiplication_2,
    C=multiplication_3,
    Expression="cos(Sum(abs(a),abs(b),abs(c)) - 2*alpha)")
multiplication_4 = Multiplication(A=expression_7, B=Slider(8.652, range=0..100))
num = Number(multiplication_4)

# ----
Z = UnitZ(Factor=Slider(21, range=-20..21))
X = UnitX(Factor="-20")
X_2 = UnitX(Factor="20")

# ---- group: Original Landscape Analysis
pt_2 = ConstructPoint(XCoordinate=pdecon.XComponent, YCoordinate=pdecon.YComponent, ZCoordinate=num)

# ----
move = Move(Geometry=pt_2, Motion=Z)  # -> Geometry, Transform

# ---- group: Original Landscape Analysis (continued)
pt_3 = Point(flatten(move.Geometry))
srfgrid = SurfaceFromPoints(Points=move.Geometry, UCount=number_slider_2, Interpolate=False)
bbox = BoundingBox(Content=srfgrid, Plane=PlaneXY(0, 0, 0))  # -> Box, Box_2
area = Area(Geometry=bbox.Box)  # -> Area, Centroid

# ---- group: Main Triangle
polygon = Polygon(Plane=area.Centroid, Radius=Slider(50, range=0..100), Segments=Slider(3, range=0..10), FilletRadius=0)  # -> Polygon, Length

# ---- group: Triangles
python = GhPythonScript(triangle=polygon.Polygon, y=Slider(2, range=0..10))  # -> out, a; inputs triangle: Curve, y: Int32
# ---------- python: Python ----------
__author__ = "karee"
__version__ = "2021.05.19"

import rhinoscriptsyntax as rs
import ghpythonlib.components as gh

elementary_triangle = [triangle]
all_triangles = [triangle]
for p in range(y):
    subtriangles = []
    for t in elementary_triangle:
        vertices = rs.CurvePoints(t)
        vertices.remove(vertices[-1])
        edges = rs.ExplodeCurves(t)
        scaled_triangle = rs.ScaleObject(t, rs.CurveAreaCentroid(t)[0], (0.5, 0.5, 1), True)
        for v in vertices:
            v_index = vertices.index(v)
            e_index = v_index + 1
            scaled_v = rs.CurvePoints(scaled_triangle)[v_index]
            opp_edge = gh.ListItem(edges, e_index, True)
            mid_pt = rs.CurveMidPoint(opp_edge)
            vec = rs.VectorCreate(mid_pt, scaled_v)
            new_triangle = rs.CopyObject(scaled_triangle, vec)
            all_triangles.append(new_triangle)
            subtriangles.append(new_triangle)
    elementary_triangle = subtriangles

a = all_triangles
a = rs.MoveObjects(a, (0, 0, -1))
# ---------- end python ----------

# ---- group: Triangles Extrusion to Pyramids
area_2 = Area(Geometry=python.a)  # -> Area, Centroid
bnd = Bounds(Numbers=area_2.Area)
remap = RemapNumbers(Value=area_2.Area, Source=bnd, Target="15 to 30")  # -> Mapped, Clipped
Z_2 = UnitZ(Factor=remap.Mapped)
move_2 = Move(Geometry=area_2.Centroid, Motion=Z_2)  # -> Geometry, Transform

# ----
lng = ListLength(List=python.a)

# ---- group: Triangles Extrusion to Pyramids / Closed Pyramids
boundary = BoundarySurfaces(Edges=python.a)
extr = ExtrudePoint(Base=boundary, Point=move_2.Geometry)

# ---- group: Triangles Extrusion to Pyramids / Open Pyramids
extr_2 = ExtrudePoint(Base=python.a, Point=move_2.Geometry)

# ---- group: Projected Points on Pyramids
debrep = DeconstructBrep(Brep=extr)  # -> Faces, Edges, Vertices
Z_3 = UnitZ(Factor="-20")
item = ListItem(List=debrep.Faces, Index=0, Wrap=True)
Z_4 = UnitZ(Factor="60")
move_3 = Move(Geometry=item, Motion=Z_3)  # -> Geometry, Transform
extr_3 = Extrude(Base=move_3.Geometry, Direction=Z_4)  # -> flatten(Extrusion)
brepsinc = PointInBreps(Brep=graft(extr_3), Point=move.Geometry, Strict=Toggle(False))  # -> Inside, Index
dispatch = Dispatch(List=move.Geometry, DispatchPattern=brepsinc.Inside)  # -> ListA, ListB
pt_4 = Point(dispatch.ListA)
line = LineSDL(Start=pt_4, Direction=Vector(0, 0, 1), Length=Slider(40, range=0..100))  # disabled
python_2 = GhPythonScript(x=line, length=lng, pyramids=flatten(extr_2))  # -> out, a, p; inputs x: tree of Curve, length: Int32, pyramids: list of Brep; disabled
# ---------- python_2: Python ----------
__author__ = "karee"
__version__ = "2021.05.26"

import rhinoscriptsyntax as rs
import ghpythonlib.treehelpers as th
import ghpythonlib.components as gh
import itertools as it

x = th.tree_to_list(x)
p = []
for i in range(length):
    intersection = gh.BrepXLine(pyramids[i], x[i])
    #print(intersection)
    p.append(intersection[1])
p= list(it.chain(*p))
# ---------- end python_2 ----------

# ----
brep = Brep(flatten(extr_2))

# ---- group: Tree to List Explanation
explaintree_th = GhPythonScript(x=dispatch.ListA)  # -> a; inputs x: tree; disabled
# ---------- explaintree_th: Python ----------
import ghpythonlib.treehelpers as th

x = th.tree_to_list(x)

a = []

for i,branch in enumerate(x):
    
    for j,item in enumerate(branch):
        s = str(i) + "[" + str(j) + "] "
        s += type(item).__name__ + ": "
        s += str(item)
        
        a.append(s)
# ---------- end explaintree_th ----------
panel = Panel(explaintree_th)  # disabled

# ----
python_3 = GhPythonScript(points=flatten(pt_4), brep=flatten(brep))  # -> out, a; inputs points: list of Point3d, brep: list of Brep
# ---------- python_3: Python ----------
import rhinoscriptsyntax as rs
import Rhino as rc


a = rc.Geometry.Intersect.Intersection.ProjectPointsToBreps(brep, points, rc.Geometry.Vector3d(0,0,1), 0.01)
# ---------- end python_3 ----------
cullpt = CullDuplicates(Points=python_3.a, Tolerance=0.1, CullMode=3)  # -> Points, Indices, Valence
debox = DeconstructBox(Box=bbox.Box_2)  # -> Plane, X, Y, Z
dedomain = DeconstructDomain(Domain=debox.Z)  # -> Start, End
addition = Addition(A="10", B=dedomain.Start)

# ---- group: Replacing Points
python_4 = GhPythonScript(x=dispatch.ListA)  # -> out, simplify(flatten(a)); inputs x: tree
# ---------- python_4: Python ----------
__author__ = "karee"
__version__ = "2021.05.26"

import rhinoscriptsyntax as rs
import ghpythonlib.treehelpers as th
import itertools as it

x = th.tree_to_list(x)
a = list(it.chain(*x))
print(type(a))
# ---------- end python_4 ----------
mindex = MemberIndex(Set=pt_3, Member=python_4.a)  # -> flatten(Index), Count; disabled
python_5 = GhPythonScript()  # -> out, a; inputs x: list of Point3d, y: list of Point3d; disabled
# ---------- python_5: Python ----------
__author__ = "karee"
__version__ = "2021.06.12"

import rhinoscriptsyntax as rs


a = []

for i in y:
    ind = x.index(i)
    a.append(ind)
# ---------- end python_5 ----------

# ----
c_script = CSharpScript(x=pt_3, y=python_4.a)  # -> out, A; inputs x: list of Point3d, y: list of Point3d
# ---------- c_script: C# ----------
    List<double> indexList = new List<double>();
    foreach (Point3d i in y)
    {
      indexList.Add(x.IndexOf(i));
    }
    A = indexList;
# ---------- end c_script ----------
panel_2 = Panel(c_script.A)

# ---- group: Replacing Points (continued)
replace = ReplaceItems(List=pt_3, Item=flatten(cullpt.Points), Indices=c_script.A, Wrap=False)
partition = PartitionList(List=replace, Size=number_slider_2)

# ----
panel_3 = Panel(python_5.a)

# ---- group: Final Landscape
pline = PolyLine(Vertices=partition, Closed=False)  # -> flatten(Polyline)
srfgrid_2 = SurfaceFromPoints(Points=replace, UCount=number_slider_2, Interpolate=False)

# ----
end = EndPoints(Curve=graft(pline))  # -> Start, End
pt_5 = Point(end.Start)
pdecon_2 = Deconstruct(Point=pt_5)  # -> XComponent, YComponent, ZComponent
pt_6 = Point(end.End)
subtraction = Subtraction(A=addition, B=pdecon_2.ZComponent)
pdecon_3 = Deconstruct(Point=pt_6)  # -> XComponent, YComponent, ZComponent
subtraction_2 = Subtraction(A=addition, B=pdecon_3.ZComponent)
Z_5 = UnitZ(Factor=subtraction)
move_4 = Move(Geometry=pt_5, Motion=Z_5)  # -> Geometry, Transform
Z_6 = UnitZ(Factor=subtraction_2)
move_5 = Move(Geometry=move_4.Geometry, Motion=X)  # -> Geometry, Transform
move_6 = Move(Geometry=pt_6, Motion=Z_6)  # -> Geometry, Transform
move_7 = Move(Geometry=move_6.Geometry, Motion=X_2)  # -> Geometry, Transform
merge = Merge(Data1=move_5.Geometry, Data2=move_4.Geometry, Data3=partition, Data4=move_6.Geometry, Data5=move_7.Geometry)
pt_7 = Point(merge)
pline_2 = PolyLine(Vertices=pt_7, Closed=False)  # -> flatten(Polyline)
index = ItemIndex(List=pline_2, Item=pline_2)
panel_4 = Panel(index)
mod = Modulus(A=index, B="2")
equals = Equality(FirstNumber=mod, SecondNumber="1")  # -> Equality, Inequality
dispatch_2 = Dispatch(List=pline_2, DispatchPattern=equals.Equality)  # -> ListA, ListB
srfgrid_3 = SurfaceFromPoints(Points=flatten(pt_7), UCount=number_slider_2, Interpolate=False)
index_2 = ItemIndex(List=pline_2, Item=dispatch_2.ListA)
flip = FlipCurve(Curve=dispatch_2.ListA)  # -> Curve, Flag
replace_2 = ReplaceItems(List=pline_2, Item=flip.Curve, Indices=index_2, Wrap=False)
connect = ConnectCurves(Curves=replace_2, Continuity=Slider(0, range=0..100), Close=Toggle(False), Bulge=1)
len = Length(Curve=connect)
division = Division(A=len, B=Slider(2000, range=0..10000))
